# Dynamo graph 20_RoomDiagram_As_Mass.dyn (Dynamo 1.3.2.2480)

color_schemme_file_excel = Filename(".\Olin Colors.xlsx")

# group: Revit Room Data Source
get_rooms_from_linked_files = BoolSelector(false)
# note: Get Room Data from Current Revit Document
categories = Categories("Rooms")
all_elements_of_category = ElementsOfCategory(categories)
# note: Get Room Data from all Linked Revit Documents
linked_docs = Python()  # unwired: IN[0]
# ---------- linked_docs.python (51 lines) ----------
#Copyright(c) 2015, Konrad K Sobon
# @arch_laboratory, http://archi-lab.net

# Huge thanks to Andreas Dieckmann for 
# adding link path functionality

import clr
clr.AddReference('ProtoGeometry')
from Autodesk.DesignScript.Geometry import *

# Import DocumentManager and TransactionManager
clr.AddReference("RevitServices")
import RevitServices
from RevitServices.Persistence import DocumentManager
from RevitServices.Transactions import TransactionManager

from System.Collections.Generic import *

# Import RevitAPI
clr.AddReference("RevitAPI")
import Autodesk
from Autodesk.Revit.DB import *
from Autodesk.Revit.DB.Analysis import *

doc = DocumentManager.Instance.CurrentDBDocument
uiapp = DocumentManager.Instance.CurrentUIApplication
app = uiapp.Application

# Import ToDSType(bool) extension method
clr.AddReference("RevitNodes")
import Revit
clr.ImportExtensions(Revit.Elements)

#The inputs to this node will be stored as a list in the IN variable.
dataEnteringNode = IN

collector = Autodesk.Revit.DB.FilteredElementCollector(doc)
linkInstances = collector.OfClass(Autodesk.Revit.DB.RevitLinkInstance)

linkDoc, linkName, linkPath = [], [], []
for i in linkInstances:
	linkDoc.append(i.GetLinkDocument())
	linkName.append(i.Name)
	try:
		linkPath.append(i.GetLinkDocument().PathName)
	except:
		del linkDoc[-1]
		linkPath.append(None)
		pass

OUT = linkDoc, linkName, linkInstances, linkPath
# ----------------------------------------
code_block = CodeBlock(out=linked_docs) { out[0]; }
categories_2 = Categories("Rooms")
get_all_elements_from_linked = Custom[Get All Elements From Linked Model](LinkDoc=code_block@L1, Category=categories_2)  # This node is based on code posted by Julien Benoit. Big thanks to Julien for sharing his work. This node will retrieve all elements of a given category from a given linked model.
flatten = Flatten(get_all_elements_from_linked)
python_script = Python(IN[0]=get_rooms_from_linked_files, IN[1]=all_elements_of_category, IN[2]=flatten)
# ---------- python_script.python (16 lines) ----------
import clr
clr.AddReference('ProtoGeometry')
from Autodesk.DesignScript.Geometry import *
#The inputs to this node will be stored as a list in the IN variables.
fileRooms = IN[1]
linkedRooms = IN[2]
fromLink = IN[0]

outRooms = []
if fromLink : outRooms = linkedRooms
else : outRooms = fileRooms




OUT = outRooms
# ----------------------------------------

filter_parameter = StringInput("Room Classification")
filter_value = StringInput("")

# group: Filter Parameters
filter_parameter_2 = CodeBlock(ParamFilter=filter_parameter) { ParamFilter; }
# note: Room parameter to use for room filtering from sample
filter_values = CodeBlock(Value=filter_value) { Value; }
# note: If 'True' values  at 'Filter Values' are included from data sample. Set to 'False' to exclude values to sample
# note: Value or list of values at parameter to include or exclude from data sample
include_true_or_exclude_false = BoolSelector(true)  # "Include(True) or Exclude (False) Filter?"

diagram_chart_parameters = StringInput("Room Classification")
diagram_chart_parameters_2 = StringInput("Using Department Name")
create = List.Create(diagram_chart_parameters, diagram_chart_parameters_2)

# group: Diagram Parameters
generate_3d_diagram = BoolSelector(false)
# note: Limiting the number of rooms to query (for testing purposes).  Disconnect from input to query all rooms.
# note: Exploded Axo: Separation between Floors (in Number of Floors)
# for
max_number_of_rooms = DoubleSlider(10000, range=0..10000 step 100)
# note: Option to visualize data without generating computaitonally expensive Revit masses
number_the_floors_for_separation = DoubleSlider(6, range=0..30 step 1)  # "Number the Floors for Separation (exploded Axo)"

chart_metric = StringInput("Area")

# group: Data Viz Parameters
# note: Room parameter to use for visualization groups
# note: If set to True, secuentially maps Viz paramters values to current color schemme .
# If set to False, material names in color schemme should match Viz paramters values
use_generic_color_schemme_true = BoolSelector(true)  # "Use Generic Color Schemme (True) or Excel File (False)"
diagram_chart_parameters_3 = CodeBlock(GroupByParameter=create) { GroupByParameter; }
# note: Room parameter to use as metric in lieu of room counts in data  visualization
metric_visualization_parameter = CodeBlock(AcumVizDataParameter=chart_metric) { AcumVizDataParameter; }  # "Metric Visualization Parameter (Chart)"
primary_parameter_index = IntegerSlider(0, range=0..10 step 1)
# note: Primary Parameter Index: Parameter List Index to use as Primary Data for Diagram and Chart
# Secondary Parameter Index: Parameter List Index to use as Secondary Data . For Chart only.
secondary_paramter_index_chart = IntegerSlider(1, range=0..10 step 1)

# group: Color Schemme Source
# note: Special Characters for Diargam and Chart Data Formatting:
# Use the '@G ' pefix to specify title of group of items that share same color.
# If no group title is spedified, the group will be named as the first of those items.
# Use the '@O ' prefix to specify title of a group that will contain all items not included in the list.
# Use the '@E ' prefix to exclude an item from the diagram and chart.
# Use the "N/A" Name to assign a color to rooms with empty parameters.
mat_name_rgb = CodeBlock()
# ---------- mat_name_rgb.designscript (22 lines) ----------
{
{"A", {204,161,198}},
{"B", {235,167,162}},
{"C", {107,190,239}},
{"D", {201,231,249}},
{"E", {154,159,178}},
{"F", {242,196,192}},
{"G", {242,199,111}},
{"H", {253,245,174}},
{"I", {198,197,197}},
{"J", {251,229,127}},
{"K", {251,226,216}},
{"L", {181,180,180}},
{"M", {149,207,161}},
{"N", {142,148,169}},
{"O", {230,224,198}},
{"P", {247,210,161}},
{"Q", {226,225,224}},
{"R", {231,160,123}},
{"S", {152,177,135}},
{"T", {219,205,205}}
};
# ----------------------------------------
fromPath = FileObject(color_schemme_file_excel)  # "File.FromPath"
string = StringInput("ToDynamo")
code_block_2 = CodeBlock(t2=fromPath, t3=string) { t1 = Excel.ReadFromFile(t2, t3, false); t4 = List.Deconstruct(t1@-2<1>); }
code_block_3 = CodeBlock(UseGeneric=use_generic_color_schemme_true) { item = UseGeneric? 0: 1; }

python_script_2 = Python(IN[0]=code_block_2.t4)
# ---------- python_script_2.python (12 lines) ----------
import clr
clr.AddReference('ProtoGeometry')
from Autodesk.DesignScript.Geometry import *
#The inputs to this node will be stored as a list in the IN variables.
schList= IN[0]
newList = []
for elem in schList:
	if  isinstance(elem[0], float) : elem[0] = str(int(elem[0]))
	if elem[0] == None: continue
	newList += [elem]
#Assign your output to the OUT variable.
OUT = newList
# ----------------------------------------

# group (continued): Color Schemme Source
create_2 = List.Create(mat_name_rgb, python_script_2)
# note: GroupBy-ParameterValue /RGBColor Table to use in Data Visualization Charts
getItemAtIndex = List.GetItemAtIndex(list=create_2, index=code_block_3)
code_block_4 = CodeBlock(MatNameRGB=getItemAtIndex) { MatNameRGB; }

# group: QUERY ENGINE
file_path = Filename("F:\Research+Innovation\1_Payette Dynamo Tools\RoomUtilities\Room Diagram with Revit Mass\20_RoomDiagram_As_Mass.py")
fromPath_2 = FileObject(file_path)  # "File.FromPath"
code_block_5 = CodeBlock(t1=fromPath_2) { t2 =File.ReadText(t1); }
parameter_filter = CodeBlock(ParamFilter=filter_parameter_2) { ParamFilter; }
filter_value_2 = CodeBlock(Value=filter_values) { Value; }
group_by_parameter = CodeBlock(GroupByParameter=diagram_chart_parameters_3) { GroupByParameter; }
parameter_for_room_volume_height = CodeBlock { "Unbounded Height"; }
code_block_6 = CodeBlock(createSolids=generate_3d_diagram) { createSolids; }
max_number_of_rooms_2 = CodeBlock(maxRooms=max_number_of_rooms) { maxRooms; }
exclude_or_include_filter_value = CodeBlock(excludeValue=include_true_or_exclude_false) { excludeValue == false; }
metric_visualization_parameter_2 = CodeBlock(AcumulativeVisualizationParameter=metric_visualization_parameter) { AcumulativeVisualizationParameter; }
python_script_from_string = PythonStringNode(script=code_block_5, IN[0]=python_script, IN[1]=parameter_filter, IN[2]=filter_value_2, IN[3]=group_by_parameter, IN[4]=parameter_for_room_volume_height, IN[5]=code_block_6, IN[6]=max_number_of_rooms_2, IN[7]=exclude_or_include_filter_value, IN[8]=metric_visualization_parameter_2)
code_block_7 = CodeBlock(data=python_script_from_string)
# ---------- code_block_7.designscript (16 lines) ----------
//avialable params
data[0];
//specified parameter values
data[1];
//room curve
data[2];
//Room Solids
data[3];
//GroupingBy data of valid solids
data[4];
//Room elements
data[5];
//Geometry Creation Log
data[6];
//Visualziation Data
data[7];
# ----------------------------------------
code_block_8 = CodeBlock(GroupingByValues=code_block_7.out4) { GroupingByValues; }
code_block_9 = CodeBlock(visDataItem=primary_parameter_index) { visDataItem; }
code_block_10 = CodeBlock(RoomSolids=code_block_7.out3) { RoomSolids; }
number_the_floors_for_separation_2 = CodeBlock(numFloorsSep=number_the_floors_for_separation) { numFloorsSep; }  # "Number the Floors for Separation (exploded Axo)"
code_block_11 = CodeBlock(RooomCurves=code_block_7.out2) { RooomCurves; }
available_parameters = CodeBlock(AvailableParameters=code_block_7.out0) { AvailableParameters; }
code_block_12 = CodeBlock(visualizationData=code_block_7.out7) { visualizationData; }
code_block_13 = CodeBlock(room=code_block_7.out5) { room; }
code_block_14 = CodeBlock(ParameterFilterValues=code_block_7.out1) { ParameterFilterValues; }
solid_creation_log = CodeBlock(log=code_block_7.out6) { log; }
code_block_15 = CodeBlock(visSubDataItem=secondary_paramter_index_chart) { visSubDataItem; }

# group: DATA FORMATING FOR DIAGRAM
code_block_16 = CodeBlock(MatNameRGB=code_block_4) { MatNameRGB; }
code_block_17 = CodeBlock(data=code_block_8) { data; }
code_block_18 = CodeBlock { "N/A"; }
code_block_19 = CodeBlock { ""; }
eq = _ == code_block_19  # unwired: arg0
# note: Set  Empty paramters as "N/A"
replaceByCondition = Replace(code_block_17, code_block_18, eq)
code_block_20 = CodeBlock(visDataItem=code_block_9) { visDataItem; }
code_block_21 = CodeBlock(names=replaceByCondition, i=code_block_20) { names[i]; }
code_block_22 = CodeBlock(solids=code_block_10) { solids; }
string_from_object = FromObject(code_block_22)
# note: Discard Room Data with Invalid Solids
groupByKey = List.GroupByKey(list=code_block_21, keys=string_from_object)
groupByKey_2 = List.GroupByKey(list=code_block_22, keys=string_from_object)
code_block_23 = CodeBlock(sepFloors=number_the_floors_for_separation_2) { sepFloors; }
code_block_24 = CodeBlock(input=code_block_23) { res = (input==null)?0:input; }

code_block_25 = CodeBlock(progs=groupByKey_2.groups) { list = progs[0][0] == None? 1: 0; }  # unwired: None

# group (continued): DATA FORMATING FOR DIAGRAM
code_block_26 = CodeBlock(progs=groupByKey.groups, i=code_block_25) { progs[i]; }

code_block_27 = CodeBlock(solids=groupByKey_2.groups, i=code_block_25) { solids[i]; }

# group (continued): DATA FORMATING FOR DIAGRAM
boundingBox = Geometry.BoundingBox(code_block_27)
code_block_28 = CodeBlock(bbox=boundingBox, elevIndex=code_block_24) { bbox.MinPoint.Z*elevIndex; }
translate = Geometry.Translate(geometry=code_block_27, zTranslation=code_block_28)
mass_values_colors = Python(IN[0]=code_block_16, IN[1]=code_block_26, IN[2]=translate)
# ---------- mass_values_colors.python (92 lines) ----------
import clr
clr.AddReference("RevitAPI")
from Autodesk.Revit.DB import *
clr.AddReference("RevitServices")
import RevitServices
from RevitServices.Persistence import DocumentManager
from RevitServices.Transactions import TransactionManager
clr.AddReference("RevitNodes")
import Revit
clr.AddReference('DSCoreNodes')
import DSCore
clr.ImportExtensions(Revit.Elements)

clr.AddReference('RevitAPIUI')
from Autodesk.Revit.UI import TaskDialog

#Creación de variables de inicio
doc = DocumentManager.Instance.CurrentDBDocument
TransactionManager.Instance.EnsureInTransaction(doc)#Función inicial
msglist = []
	
matNameRGBList = IN[0]
paramNames = IN[1]
solidData = IN[2]

newMatNameRGBList = []
nameRBGGroups = []
excludeNames = []
otherName = None

# detect special characters for grouping values
for i, data in enumerate(matNameRGBList):
	name, rgb = data
	newName = name
	if name[0:3] == '@G ' or name[0:3] == '@O ' or name[0:3] == '@E ': 
		newName = name[3:len(name)]
		nameRBGGroups.append([newName, rgb])
		matNameRGBList[i][0] = newName
		if name[0:3] == '@O ' : otherName = newName
		if name[0:3] == '@E ' : excludeNames.append(newName)
	if name[0:3] <> '@E ' : newMatNameRGBList.append([newName, rgb])
#msglist.append(nameRBGGroups)		
#msg = str(msglist)
#TaskDialog.Show('Test', str(msg))


# Create ParamVal = rgb Dictionary
colorDict = {}
for nameRGB  in matNameRGBList:
	if nameRGB:
		name, rgb = nameRGB
		#r,g,b = rgb
		colorDict[name] = rgb #DSCore.Color.ByARGB(255,r,g,b)


# Map Parameter values to colors
overrideName = list(name for name, rgb in nameRBGGroups)
overrideRGB = list(rgb for name, rgb in nameRBGGroups)
colorList = []
newParamNames = []
newSolidData = []
defaultRGB = [1,1,1]

for index, paramVal in enumerate(paramNames):
	# remove excluded values
	if paramVal in excludeNames: continue
	
	newParamNames.append(paramVal)
	newSolidData.append(solidData[index])
	# obtain color based on name
	color = None
	try:
		color = colorDict[paramVal]
	except:
		if otherName: color = colorDict[otherName]
		
	#override names if found in override list
	for rgb in overrideRGB:
		if color == rgb : 
			newParamNames[-1] = overrideName[overrideRGB.index(rgb)]
			break
				
	# create & store colors for the chart			
	#if color == None: 
		#color = defaultRGB
	#r,g,b = color
	#color = DSCore.Color.ByARGB(255,r,g,b)
	#colorList.append(color)
	

# output the final formatted data, colors and names for the charts
OUT = [newMatNameRGBList] + [newParamNames] + [newSolidData]
# ----------------------------------------
code_block_29 = CodeBlock(out=mass_values_colors) { out[0]; out[1]; out[2]; }

code_block_30 = CodeBlock(solids=code_block_29.out2) { solids; }

# group: Material Properties
code_block_31 = CodeBlock { "SPACE_"; }
mat_name_and_color = CodeBlock(MatProperties=code_block_4) { MatProperties; }  # frozen
deconstruct = List.Deconstruct(list=mat_name_and_color@L3)
code_block_32 = CodeBlock { "@O "; }
code_block_33 = CodeBlock { ""; }
code_block_34 = CodeBlock { "@E "; }
code_block_35 = CodeBlock { "@G "; }
code_block_36 = CodeBlock(t2=deconstruct.first, t3=code_block_32, t4=code_block_33, t6=code_block_34, t7=code_block_35) { t1 = String.Replace(t2@-1<1>, t3, t4); t5 = String.Replace(t1@-1<1>, t6, t4); t8 = String.Replace(t5@-1<1>, t7, t4); }
code_block_37 = CodeBlock(pref=code_block_31, list=code_block_36.t8) { pref+list[0..Count(list)-1]; }
code_block_38 = CodeBlock { 1; }
RGBs = List.Flatten(list=deconstruct.rest, amt=code_block_38)

# group: Retrieve Existing Revit Materials if Names match
byName = Material.ByName(code_block_37@L1)
boolean = BoolSelector(false)
clean = List.Clean(list=byName, preserveIndices=boolean)

# group: Automate Room Value / Material Index Table
join = List.Join()  # unwired: arg0, arg1
code_block_39 = CodeBlock(names=code_block_29.out1) { names; }
groupByKey_3 = List.GroupByKey(list=code_block_39, keys=code_block_39)
code_block_40 = CodeBlock { "N/A"; }
code_block_41 = CodeBlock { ""; }
eq_2 = _ == code_block_41  # unwired: arg0
replaceByCondition_2 = Replace(groupByKey_3.unique_keys, code_block_40, eq_2)
code_block_42 = CodeBlock(list=replaceByCondition_2) { (0..Count(list)-1); }
combine = List.Combine(join, replaceByCondition_2, code_block_42)
use_generic_color_maping = CodeBlock(UseGenericColors=use_generic_color_schemme_true) { UseGenericColors; }

code_block_43 = CodeBlock(names=code_block_29.out1) { names; }

# group: CREATE MATERIALS AND MAP ROOM PARAMETERS TO MATERIALS
new_mat_names = CodeBlock(names=code_block_37) { names; }
mats_colors = CodeBlock(RBG=RGBs) { RBG; }
transparency = CodeBlock { 0; }
existing_mats = CodeBlock(Mats=clean) { Mats; }
create_missing = BoolSelector(true)
materials_from_name_rgb_lists = Python(IN[0]=new_mat_names, IN[1]=mats_colors, IN[2]=transparency, IN[3]=existing_mats, IN[4]=create_missing)
# ---------- materials_from_name_rgb_lists.python (64 lines) ----------
import clr
clr.AddReference("RevitAPI")
from Autodesk.Revit.DB import *
clr.AddReference("RevitServices")
import RevitServices
from RevitServices.Persistence import DocumentManager
from RevitServices.Transactions import TransactionManager
clr.AddReference("RevitNodes")
import Revit
clr.ImportExtensions(Revit.Elements)

#Creación de variables de inicio
doc = DocumentManager.Instance.CurrentDBDocument
#TransactionManager.Instance.EnsureInTransaction(doc)

def ToRevitColor(rgb):
	r,g,b = rgb
	return Color(r, g, b)

def ToDynamoObject(revitObject, isRevitOwned=False):
	return revitObject.ToDSType(isRevitOwned)


newMaterials = []

matNames= IN[0]
if not isinstance(matNames, list): matNames = [matNames]

rgbs = IN[1]
transparency = IN[2]
existingMats = IN[3]
createMissing = IN[4]
#spattern = IN[3]
#cpattern = IN[4]

if existingMats :
	existingMatNames = list(mat.Name for mat in existingMats)
else: existingMatNames = []

for i, name in enumerate(matNames):
	if name in existingMatNames: 
		existing_mat = existingMats[existingMatNames.index(name)]
		newMaterials.append(existing_mat)
	elif createMissing:
		TransactionManager.Instance.EnsureInTransaction(doc)
		color = ToRevitColor(rgbs[i])
		new_mat_id = Material.Create(doc, name)
		new_mat = doc.GetElement(new_mat_id)
		new_mat.Color = color
		new_mat.Transparency = transparency
#new_mat.SurfacePatternId = spattern
#new_mat.SurfacePatternColor = color
#new_mat.CutPatternId = cpattern
#new_mat.CutPatternColor = color
		newMaterials.append(ToDynamoObject(new_mat))
		TransactionManager.Instance.TransactionTaskDone()
	else:
		newMaterials.append("Missing "+ name + " material in Revit")
		


#Extracción de materiales

OUT = newMaterials
# ----------------------------------------
param_value_mat_index_table = CodeBlock(ValueIndexPairs=combine) { ValueIndexPairs; }
room_parameter_values = CodeBlock(ParamValues=code_block_43) { ParamValues; }
default_material_index = CodeBlock { "SPACE_N/A"; }
use_generic_color_maping_2 = CodeBlock(UseGenericColors=use_generic_color_maping) { UseGenericColors; }
materials_from_name_rgb_lists_2 = Python(IN[0]=materials_from_name_rgb_lists, IN[1]=param_value_mat_index_table, IN[2]=room_parameter_values, IN[3]=default_material_index, IN[4]=use_generic_color_maping_2)
# ---------- materials_from_name_rgb_lists_2.python (64 lines) ----------
import math
import clr
clr.AddReference("RevitAPI")
from Autodesk.Revit.DB import *
clr.AddReference("RevitServices")
import RevitServices
from RevitServices.Persistence import DocumentManager
from RevitServices.Transactions import TransactionManager
clr.AddReference("RevitNodes")
import Revit
clr.ImportExtensions(Revit.Elements)


doc = DocumentManager.Instance.CurrentDBDocument
TransactionManager.Instance.EnsureInTransaction(doc)



materials = IN[0]
programMatList = IN[1]
useGenericColorMapping = IN[4]

if  programMatList == None or useGenericColorMapping == False:
	tmpList = []
	for i, mat in enumerate(materials):
		matName = mat.Name
		if matName.startswith("SPACE_"): matName = matName.replace("SPACE_", "", 1)
		tmpList.append([matName, i])
	programMatList = tmpList
	
programList = IN[2]

default = IN[3]
matList = []
matDict = {}



for progIndex  in programMatList:
	if progIndex:
		prog,i = progIndex
	else:
		prog = "N/A"; i = default
	if i >= len(materials): i = i-int(i/len(materials))*len(materials)
	
	matDict[prog] = materials[i].Name
	#outList = matDict.items()	
		

for program in programList:
	matName = None
	try:
		if matDict[program] <> None :
			matName = matDict[program]
	except:
		pass
		
	if matName == None:
		if default <> None : matName = default
		else: matName = programMatList[0][0]
	
	matList.append(matName)
	
OUT = matList
# ----------------------------------------
byName_2 = Material.ByName(materials_from_name_rgb_lists_2)

# group: Create Mass with Parameter Values
code_block_44 = CodeBlock(materials=byName_2) { materials; }
color = Material.Color(code_block_44)
byGeometryColor = Display.Display.ByGeometryColor(code_block_30, color)  # frozen
categories_3 = Categories("Mass")
code_block_45 = CodeBlock(list=code_block_43) { "SpacePlan_Mass_"+(0..Count(list)-1); }
byGeometry = DirectShape.ByGeometry(geometry=code_block_30, category=categories_3, material=code_block_44, name=code_block_45)
code_block_46 = CodeBlock { "Comments"; }
setParameterByName = Element.SetParameterByName(element=byGeometry, parameterName=code_block_46, value=code_block_43)

group_by_parameter_2 = CodeBlock(GroupByParameter=group_by_parameter) { GroupByParameter; }

# group: DATA FORMATTING FOR VISUALIZATION
code_block_47 = CodeBlock(MatNameRGB=code_block_4) { MatNameRGB; }
code_block_48 = CodeBlock(names=replaceByCondition) { names; }
subNames = BoolSelector(false)
code_block_49 = CodeBlock(visualizationData=code_block_12) { visualizationData; }
# note: Selection of Room Counts or Acumulative Viz Data
code_block_50 = CodeBlock(MatNameRGB=code_block_47, names=code_block_48, subNames=subNames, visData=code_block_49)
# ---------- code_block_50.designscript (15 lines) ----------
MatNameRGB;
names;
dataCount = Count(subNames);
fNames = (dataCount == 1)? names : names +"_+_"+ subNames;
//Names
data = DSCore.List.GroupByKey(fNames@-2<1>, fNames@-2<1>);
nGroups = __TryGetValueFromNestedDictionaries(data, "groups");
keys = __TryGetValueFromNestedDictionaries(data, "unique keys");
//VisFata
vData = DSCore.List.GroupByKey(visData, fNames@-2<1>);
vGroups = __TryGetValueFromNestedDictionaries(vData, "groups");
// Count type (rooms counts or other metric (visData)
vDataCount = Count(visData);
nGroupCount = Count(nGroups@-2<1>);
metricData = vDataCount == 0? nGroupCount : Math.Sum(vGroups);
# ----------------------------------------
param_value_mat_index_table_2 = CodeBlock(ValueIndexPairs=combine) { ValueIndexPairs; }
chart_titles_colors = Python(IN[0]=code_block_50.MatNameRGB, IN[1]=code_block_50.keys, IN[2]=code_block_50.metricData, IN[3]=param_value_mat_index_table_2)
# ---------- chart_titles_colors.python (122 lines) ----------
import clr
clr.AddReference("RevitAPI")
from Autodesk.Revit.DB import *
clr.AddReference("RevitServices")
import RevitServices
from RevitServices.Persistence import DocumentManager
from RevitServices.Transactions import TransactionManager
clr.AddReference("RevitNodes")
import Revit
clr.AddReference('DSCoreNodes')
import DSCore
clr.ImportExtensions(Revit.Elements)

clr.AddReference('RevitAPIUI')
from Autodesk.Revit.UI import TaskDialog

#Creación de variables de inicio
doc = DocumentManager.Instance.CurrentDBDocument
TransactionManager.Instance.EnsureInTransaction(doc)#Función inicial
msglist = []
	
matNameRGBList = IN[0]
paramNamesLists = IN[1]
paramDataLists = IN[2]

nameRBGGroups = []
excludeNames = []
otherName = None
separator = "_+_"

# detect special characters for grouping values
for i, data in enumerate(matNameRGBList):
	name, rgb = data
	if name[0:3] == '@G ' or name[0:3] == '@O ' or name[0:3] == '@E ': 
		newName = name[3:len(name)]
		nameRBGGroups.append([newName, rgb])
		matNameRGBList[i][0] = newName
		if name[0:3] == '@O ' : otherName = newName
		if name[0:3] == '@E ' : excludeNames.append(newName)
		
#msglist.append(nameRBGGroups)		
#msg = str(msglist)
#TaskDialog.Show('Test', str(msg))


# Create ParamVal = rgb Dictionary
colorDict = {}
for nameRGB  in matNameRGBList:
	if nameRGB:
		name, rgb = nameRGB
		#r,g,b = rgb
		colorDict[name] = rgb #DSCore.Color.ByARGB(255,r,g,b)


# Map Parameter values to colors
overrideName = list(name for name, rgb in nameRBGGroups)
overrideRGB = list(rgb for name, rgb in nameRBGGroups)

newParamNames = []
newParamData = []
defaultRGB = [1,1,1]
colorLists = []
newParamNamesLists = []
newParamDataLists = []
	
for pIndex, paramNames in enumerate(paramNamesLists):
	paramData = paramDataLists[pIndex]
	colorList = []
	newParamNames = []
	newParamData = []
	for index, paramVal in enumerate(paramNames):
	
		if "_+_" in paramVal:
			paramVals = paramVal.split(separator, 1)	
		else: paramVals = [paramVal]
		
		# remove excluded values
		if paramVals[0] in excludeNames: continue
		
		newName = []
		
		for i, pVal in enumerate(paramVals):
	
			# obtain color based on name
			color = None
			try:
				color = colorDict[pVal]
			except:
				if otherName: color = colorDict[otherName]
				
			#override names if found in override list
			for rgb in overrideRGB:
				if color == rgb : 
					pVal = overrideName[overrideRGB.index(rgb)]
					break
					
			newName.append(pVal)
			
			if i == 0 : 
				storeColor = color
				storeName = newName[0]
			if i == 1:		
				storeName =  storeName + separator + newName[1]
				storeTmpColor = zip(storeColor, color)
				storeColor = list(int((a+b)/2) for a,b in  storeTmpColor)
				
		newParamNames.append(storeName)		
		newParamData.append(paramData[index])
			
		# create & store colors for the chart			
		if storeColor == None: 
			storeColor = defaultRGB
		r,g,b = storeColor
		storeColor = DSCore.Color.ByARGB(255,r,g,b)
		colorList.append(storeColor)
		
	colorLists.append(colorList)
	newParamNamesLists.append(newParamNames)
	newParamDataLists.append(newParamData)

# output the final formatted data, colors and names for the charts
OUT = [colorLists] + [newParamNamesLists] + [newParamDataLists]
# ----------------------------------------
code_block_51 = CodeBlock(out=chart_titles_colors)
# ---------- code_block_51.designscript (6 lines) ----------
//colorList
out[0];
//newParamNames
out[1];
//newParamData
out[2];
# ----------------------------------------
code_block_52 = CodeBlock(MatNameRGB=code_block_4) { MatNameRGB; }
color_list = Python(IN[0]=use_generic_color_schemme_true, IN[1]=code_block_52, IN[2]=code_block_51.out0)
# ---------- color_list.python (42 lines) ----------
import clr
clr.AddReference("RevitAPI")
from Autodesk.Revit.DB import *
clr.AddReference("RevitServices")
import RevitServices
from RevitServices.Persistence import DocumentManager
from RevitServices.Transactions import TransactionManager
clr.AddReference("RevitNodes")
import Revit
clr.AddReference('DSCoreNodes')
import DSCore
clr.ImportExtensions(Revit.Elements)


useGenericColors = IN[0]
defRGBs = IN[1]

# create & store colors for the chart
defColors = []
for item in defRGBs:
	n, rgb = item
	r,g,b = rgb
	storeColor = DSCore.Color.ByARGB(255,r,g,b)
	defColors.append(storeColor)

progColors = IN[2]
outColorLists = []

for progList in progColors:
	colors = []
	if useGenericColors :
		if len(defColors) > 0 and len(progList) > 0:
			finalLength = len(progList)
			while finalLength > len(defColors):
				defColors += defColors
			colors =  defColors[0:finalLength]
	else: 
		colors = progList
			
	outColorLists.append(colors)

OUT = outColorLists
# ----------------------------------------
# note: DATA FORMATTING
code_block_53 = CodeBlock(paramData=code_block_51.out2, colorList=color_list, paramNames=code_block_51.out1)
# ---------- code_block_53.designscript (11 lines) ----------
pData = DSCore.List.GroupByKey(paramData@-2<1>, colorList@-2<1>);
pGroups = __TryGetValueFromNestedDictionaries(pData, "groups");
data = Math.Floor(Math.Sum(pGroups));
//
cData = DSCore.List.GroupByKey(colorList@-2<1>, colorList@-2<1>);
cGroups = __TryGetValueFromNestedDictionaries(cData, "groups");
colorFirst = DSCore.List.FirstItem(cGroups@@-2<1>);
//
pNamesData = DSCore.List.GroupByKey(paramNames@-2<1>, colorList@-2<1>);
pNamesGroups = __TryGetValueFromNestedDictionaries(pNamesData, "groups");
DSCore.List.FirstItem(pNamesGroups@@-2<1>);
# ----------------------------------------
code_block_54 = CodeBlock(colors=code_block_53.colorFirst) { colors; }
code_block_55 = CodeBlock(data=code_block_53.data) { data; }
code_block_56 = CodeBlock(names=code_block_53.out8) { names; }
code_block_57 = CodeBlock { shift = 300; margin = 120; size = 900; dotSize = 2; domY0 = 0; domY1 = 1500; t4 = 1400; t5 = 900; }
settings = CodeBlock(shiftX=code_block_57.shift, shifty=code_block_57.shift, mrg=code_block_57.margin) { t2 = MiscNodes.Address(shiftX, shifty); t4 = MiscNodes.Margins(mrg, mrg, mrg, mrg); }

# group: DATA DUMP
available_parameters_2 = CodeBlock(AvailableParameters=available_parameters) { AvailableParameters; }
# note: AVAILABLE PARAMETERS IN ROOMS
available_filter_parameters = Watch(available_parameters_2)
addItemToFront = List.AddItemToFront()  # unwired: item, list
code_block_58 = CodeBlock(t3=code_block_13, t4=parameter_filter, t8=code_block_14, vData=code_block_8)
# ---------- code_block_58.designscript (14 lines) ----------
t2 = t3.GetParameterValueByName(t4);
t5 = DSCore.List.GroupByKey(t2, t2);
t6 = __TryGetValueFromNestedDictionaries(t5, "groups");
a = __TryGetValueFromNestedDictionaries(t5, "unique keys");
t9 = DSCore.List.GroupByKey(t8, t8);
fG = __TryGetValueFromNestedDictionaries(t9, "groups");
b = __TryGetValueFromNestedDictionaries(t9, "unique keys");
fGC = Count(fG@-2<1>);
t1 = ((a + "(") + b) + ")";
t12 = Count(t6@-2<1>);
gVd = DSCore.List.GroupByKey(vData@-2<1>, vData@-2<1>);
t13 = __TryGetValueFromNestedDictionaries(gVd, "unique keys");
t14 = __TryGetValueFromNestedDictionaries(gVd, "groups");
t15 = Count(t14@@-2<1>);
# ----------------------------------------
combine_2 = List.Combine(addItemToFront, code_block_58.b, code_block_58.fGC)
# note: SELECTED FILTER PARAMETER VALUES AND COUNTS
current_filter_values_and_counts = Watch(combine_2)
laceLongest = List.LaceLongest(addItemToFront, code_block_58.t13, code_block_58.t15)
# note: SELECTED VIZ PARAMETER VALUES AND COUNTS
current_viz_parameter_values = Watch(laceLongest)  # "CURRENT VIZ PARAMETER VALUES & COUNTS"
combine_3 = List.Combine(addItemToFront, code_block_58.t1, code_block_58.t12)
filter_code_values_room_counts = CodeBlock(forDebug=combine_3) { forDebug; }
addItemToFront_2 = List.AddItemToFront()  # unwired: item, list
code_block_59 = CodeBlock(visSubDataItem=code_block_9) { visSubDataItem; }
code_block_60 = CodeBlock(colors=code_block_54, i=code_block_59, data=code_block_55, names=code_block_56) { colors[i]; data[i]; names[i]; }
combine_4 = List.Combine(addItemToFront_2, code_block_60.out2, code_block_60.out1)
# note: PROCESSED VIZ PARAMETER VALUES AND COUNTS
processed_viz_parameter_values = Watch(combine_4)  # "PROCESSED VIZ PARAMETER VALUES AND METRIC RESULTS"

# group: STACKED BAR CHART (Stacking matching values of two parameters)
code_block_61 = CodeBlock(list=group_by_parameter_2) { myList = list[0..1]; DSCore.List.AddItemToFront("Groups", myList); }
join_2 = List.Join()  # unwired: arg0, arg1, arg2
code_block_62 = CodeBlock(colors=code_block_54, data=code_block_55, names=code_block_56) { colors[1]; data[1]; names[1]; }
code_block_63 = CodeBlock(data1=code_block_62.out1) { data1; }
code_block_64 = CodeBlock(colors=code_block_54, data=code_block_55, names=code_block_56) { colors[0]; data[0]; names[0]; }
indexOf = IndexOf(code_block_64.out2, code_block_62.out2@L1)
getItemAtIndex_2 = List.GetItemAtIndex(list=code_block_64.out1, index=indexOf@L1)
code_block_65 = CodeBlock { 0; }
code_block_66 = CodeBlock { null; }
eq_3 = _ == code_block_66  # unwired: arg0
replaceByCondition_3 = Replace(getItemAtIndex_2, code_block_65, eq_3)
code_block_67 = CodeBlock(data2=replaceByCondition_3) { data2; }
combine_5 = List.Combine(join_2, code_block_62.out2, code_block_63, code_block_67)
code_block_68 = CodeBlock { 0; }
add = code_block_63@L1 + code_block_67@L1
code_block_69 = CodeBlock(t3=add) { val = DSCore.List.MaximumItem(t3) + 10; }
domain = Charts.MiscNodes.Domain(code_block_68, code_block_69)
code_block_70 = CodeBlock { null; }
code_block_71 = CodeBlock { "Area"; }
code_block_72 = CodeBlock(t2=code_block_61.out1, t3=combine_5, t4=domain, t6=code_block_70, gridaddress1=settings.t2, margins1=settings.t4, t7=code_block_57.t4, t8=code_block_57.t5, t9=code_block_71)
# ---------- code_block_72.designscript (3 lines) ----------
t1 = Charts.StackedBarChart.Data(t2, t3, t4);
t5 = Charts.StackedBarChart.Style(DSCore.Color.ByARGB(1, 255, 0, 0), t6, gridaddress1, margins1, t7, t8, t9);
t10 = Charts.StackedBarChart.Chart(t1, t5);
# ----------------------------------------
stacked_bar_chart = CodeBlock(Chart=code_block_72.t10) { Chart; }

create_report = MandrillReportNode(stacked_bar_chart)
code_block_73 = CodeBlock()
# ---------- code_block_73.designscript (7 lines) ----------
LEVEL_1 = "30";
B_SUB_LEVEL_2= "-1";
C_SUB_LEVEL_1 = "176469";
LEVEL_2 = "9946";
LEVEL_3 = "171602";
LEVEL_4 = "172356";
LEVEL_5 = "172885";
# ----------------------------------------

# group: SCATTER PLOT
toDouble = Custom[ToDouble]()  # This node converts strings to doubles. When strings look like this: "0", "1" etc. and don't have decimal places the ToNumber node fails on occasion. This addresses that issue.; unwired: string
string_from_object_2 = FromObject(toDouble)
scatter_plot_chart = CodeBlock(dataY=toDouble, dotSize=code_block_57.dotSize, domY0=code_block_57.domY0, domY1=code_block_57.domY1, names=string_from_object_2, address=settings.t2, margins=settings.t4, width=code_block_57.t4, height=code_block_57.t5)
# ---------- scatter_plot_chart.designscript (7 lines) ----------
dataX = (0..Count(dataY)-1);
dotSizes = DSCore.List.Cycle(dotSize, Count(dataX));
domainX = MiscNodes.Domain(0, Count(dataX));
domainY = MiscNodes.Domain(domY0, domY1);
t11 = ScatterPlot.Data(names, dataX, dataY, dotSizes, dataY, domainX, domainY);
t13 = ScatterPlot.Style(MiscNodes.GetColorList(), address, margins, width, height, "sq ft", "rooms");
t17 = ScatterPlot.Chart(t11, t13);
# ----------------------------------------
scatter_plot_chart_2 = CodeBlock(Chart=scatter_plot_chart.t17) { Chart; }

# group: DONUT & PIE CHARTS
code_block_74 = CodeBlock(visDataItem=code_block_9) { visDataItem; }
code_block_75 = CodeBlock(colors=code_block_54, i=code_block_74, data=code_block_55, names=code_block_56) { colors[i]; data[i]; names[i]; }
pie_chart = CodeBlock(t2=code_block_75.out2, t3=code_block_75.out1, colors=code_block_75.out0, margins1=settings.t4, size=code_block_57.size)  # unwired: gridaddress1
# ---------- pie_chart.designscript (3 lines) ----------
t1 = Charts.PieChart.Data(t2, t3);
t4 = Charts.PieChart.Style(DSCore.Color.ByARGB(1, 255, 0, 0), colors, gridaddress1, margins1, size, true);
t6 = Charts.PieChart.Chart(t1, t4);
# ----------------------------------------
pie_chart_2 = CodeBlock(Chart=pie_chart.t6) { Chart; }
donut_chart = CodeBlock(t2=code_block_75.out2, t3=code_block_75.out1, colors=code_block_75.out0, gridaddress1=settings.t2, margins1=settings.t4, t5=code_block_57.size)
# ---------- donut_chart.designscript (3 lines) ----------
t1 = Charts.DonutChart.Data(t2, t3);
t4 = Charts.DonutChart.Style(DSCore.Color.ByARGB(1, 255, 0, 0), colors, gridaddress1, margins1, t5, true, "TOTAL");
t6 = Charts.DonutChart.Chart(t1, t4);
# ----------------------------------------
donut_chart_2 = CodeBlock(Chart=donut_chart.t6) { Chart; }

# group: ROOM GEOMETRY CHECKING
categories_4 = Categories("Rooms")
all_elements_of_category_2 = ElementsOfCategory(categories_4)
filtering_rooms_by_index = CodeBlock { {1,104,106,113,292,295,341,347,435,483,888,1665}; }
removeItemAtIndex = List.RemoveItemAtIndex(list=all_elements_of_category_2, indices=filtering_rooms_by_index)  # frozen
parameter_for_room_volume_height_2 = CodeBlock { "Unbounded Height"; }
max_number_of_rooms_3 = CodeBlock { null; }
room_utility = Python(IN[0]=removeItemAtIndex, IN[1]=parameter_for_room_volume_height_2, IN[2]=max_number_of_rooms_3)
# ---------- room_utility.python (89 lines) ----------
import clr

clr.AddReference('ProtoGeometry')
from Autodesk.DesignScript.Geometry import *

clr.AddReference("RevitAPI")
from Autodesk.Revit.DB import *

clr.AddReference('RevitAPIUI')
from Autodesk.Revit.UI import TaskDialog

clr.AddReference("RevitServices")
from RevitServices.Persistence import DocumentManager
from RevitServices.Transactions import TransactionManager

clr.AddReference("RevitNodes")

import Revit
# Import ToProtoType, ToRevitType geometry conversion extension methods
clr.ImportExtensions(Revit.GeometryConversion)
# Import Element wrapper extension methods
clr.ImportExtensions(Revit.Elements)
#doc =  DocumentManager.Instance.CurrentDBDocument

roomsList =  UnwrapElement(IN[0])	
roomHeightParam = IN[1]
tryExtractSolid = IN[2]

msglist = []

roomsRegions = []
roomsSolids = []
roomElements = []
roomsSegments = []
solidTypes = []
roomCounter = 0
roomElem = None

def get_solid(element):
    geos = []
    for geo in element.get_Geometry(Options()):
        geos.append(geo)
    return geos[0].ToProtoType()

for i, room in enumerate(roomsList):
	
	roomCounter +=1
	solidType = "No Area"
	roomElem = room
	roomSegs = None; roomPoly = None; roomSolid = None
	#create Solids from rooms
	if room.Area > 0:
		# extract room perimeter curves
		solidType = "Invalid Curves"
		roomBoundaries = room.GetBoundarySegments(SpatialElementBoundaryOptions())
		roomCurves = []
		for roomBoundary in roomBoundaries:
			for boundarySegment in roomBoundary:
				curve = boundarySegment.GetCurve()
				roomCurves.append(curve.ToProtoType())
		try:
			roomPoly = PolyCurve.ByJoinedCurves(roomCurves)
			roomHeight=room.GetParameters(roomHeightParam)[0].AsDouble()
			if roomHeight == 0 or roomHeight == None: roomHeight=10
			roomSolid = roomPoly.ExtrudeAsSolid(roomHeight)		
			solidType = "By Curves"
		except:
			pass
		
		if roomPoly == None:
			try:
				if tryExtractSolid: 
					roomSolid = get_solid(room)
				roomSegs = roomCurves
				solidType = "By Solid"
			except:
				roomSegs = roomCurves
				solidType = "Can't Create"

	roomsRegions.append(roomPoly)
	roomsSolids.append(roomSolid)
	roomsSegments.append(roomSegs)
	roomElements.append(roomElem)
	solidTypes.append(solidType)
 
 
msg = str(msglist)
#TaskDialog.Show('Test', str(msg))
OUT = [roomsRegions]+[roomsSolids]+[roomElements]+[roomsSegments]+[solidTypes]
# ----------------------------------------
code_block_76 = CodeBlock(data=room_utility) { data[0]; data[1]; data[2]; data[3]; data[4]; }
watch = Watch(code_block_76.out1)
code_block_77 = CodeBlock(solids=code_block_76.out1) { solids; }
number_slider = DoubleSlider(0, range=0..100 step 1)
number_slider_2 = DoubleSlider(23, range=0..100 step 1)
code_block_78 = CodeBlock(list=all_elements_of_category_2, i=number_slider, c=number_slider_2) { list[i..c]; }
watch_2 = Watch(code_block_76.out4)
groupByKey_4 = List.GroupByKey(list=code_block_76.out3, keys=watch_2)
code_block_79 = CodeBlock(curves=groupByKey_4.groups) { curves[1]; }
watch_3 = Watch(code_block_76.out2)
groupByKey_5 = List.GroupByKey(list=watch_3, keys=watch_2)
code_block_80 = CodeBlock(rooms=groupByKey_5.groups) { rooms[1]; }
geometry = Element.Geometry(code_block_80)
flatten_2 = Flatten(geometry)
groupByKey_6 = List.GroupByKey(list=code_block_79, keys=flatten_2)
invalid_rooms_profiles = CodeBlock(profiles=groupByKey_6.groups) { profiles[0]; }
room_number = DoubleSlider(0, range=0..30 step 1)
selected_room_profile = CodeBlock(profiles=invalid_rooms_profiles, i=room_number) { profiles[i]; }
groupByKey_7 = List.GroupByKey(list=code_block_80, keys=flatten_2)
invalid_rooms = CodeBlock(rooms=groupByKey_7.groups) { rooms[0]; }
allIndicesOf = List.AllIndicesOf(list=all_elements_of_category_2, item=invalid_rooms@L1)
invalid_rooms_indices = Flatten(allIndicesOf)
selected_room = CodeBlock(rooms=invalid_rooms, i=room_number) { rooms[i]; }
code_block_81 = CodeBlock { "Level"; }
getParameterValueByName = Element.GetParameterValueByName(element=selected_room, parameterName=code_block_81)

# group: STACKED BAR (STacking based on secondoray parameter provided)
code_block_82 = CodeBlock(MatNameRGB=code_block_47) { MatNameRGB; }
code_block_83 = CodeBlock(names=code_block_48) { names; }
code_block_84 = CodeBlock(visDataItem=code_block_9) { visDataItem; }
code_block_85 = CodeBlock(names=code_block_83, i=code_block_84) { names[i]; }
code_block_86 = CodeBlock(visualizationData=code_block_49) { visualizationData; }
code_block_87 = CodeBlock(visSubDataItem=code_block_15) { visSubDataItem; }
code_block_88 = CodeBlock(names=code_block_83, i=code_block_87) { names[i]; }
chart_Data_Formatting = Custom[Chart_Data_Formatting](MatNameRGB=code_block_82, names=code_block_85@L2, visData=code_block_86, subNames=code_block_88)
code_block_89 = CodeBlock(colors=chart_Data_Formatting.colors, data=chart_Data_Formatting.data, names=chart_Data_Formatting.names) { colors[0]; data[0]; names[0]; }
code_block_90 = CodeBlock { "_+_"; }
split = String.Split(code_block_89.out2, code_block_90)
lastItem = List.LastItem(split@L2)
firstItem = List.FirstItem(split@L2)
groupByKey_8 = List.GroupByKey(list=lastItem, keys=firstItem)
code_block_91 = CodeBlock { "Groups"; }
groupByKey_9 = List.GroupByKey(list=lastItem, keys=lastItem)
addItemToFront_3 = List.AddItemToFront(item=code_block_91, list=groupByKey_9.unique_keys)
groupByKey_10 = List.GroupByKey(list=firstItem, keys=firstItem)
firstItem_2 = List.FirstItem(groupByKey_10.groups@L2)
groupByKey_11 = List.GroupByKey(list=code_block_89.out1, keys=firstItem)
transpose = List.Transpose(groupByKey_11.groups)
transpose_2 = List.Transpose(transpose)
code_block_92 = CodeBlock { 0; }
code_block_93 = CodeBlock { null; }
eq_4 = _ == code_block_93  # unwired: arg0
replaceByCondition_4 = Replace(transpose_2, code_block_92, eq_4)
addItemToFront_4 = List.AddItemToFront(item=firstItem_2@L1, list=replaceByCondition_4@L2)
code_block_94 = CodeBlock { 0; }
sum = Math.Sum(replaceByCondition_4@L2)
code_block_95 = CodeBlock(t3=sum) { val = DSCore.List.MaximumItem(t3) + 10; }
domain_2 = Charts.MiscNodes.Domain(code_block_94, code_block_95)
code_block_96 = CodeBlock(t2=addItemToFront_3, t3=addItemToFront_4, t4=domain_2, t6=code_block_70, gridaddress1=settings.t2, margins1=settings.t4, t7=code_block_57.t4, t8=code_block_57.t5, t9=code_block_71)  # same code as code_block_72
stacked_bar_chart_2 = CodeBlock(Chart=code_block_96.t10) { Chart; }

create_report_2 = MandrillReportNode(donut_chart_2)

# group: Charts
stacked_bar_chart_window = MandrillWindowNodeModel(create_report)
file_path_2 = Filename("C:\temp\test.html")
save_to_html = MandrillHtmlNodeModel(file_path_2)  # unwired: arg1
donut_chart_window = MandrillWindowNodeModel(create_report_2)

code_block_97 = CodeBlock { ""; }
